% Simulink data dictionary BalanceCar.sldd

Motor1PWM = Simulink.Signal(StorageClass="ExportedGlobal", DataType="uint16")
Motor2PWM = Simulink.Signal(StorageClass="ExportedGlobal", DataType="uint16")
BatteryVoltage = Simulink.Signal(StorageClass="ExportedGlobal", DataType="single")
Int = Simulink.Signal(StorageClass="ExportedGlobal", DataType="uint8")
NUM0 = Simulink.Parameter(0, StorageClass="Define", DataType="uint8")
NUM1 = Simulink.Parameter(1, StorageClass="Define", DataType="uint8")
NUM2 = Simulink.Parameter(2, StorageClass="Define", DataType="uint8")
NUM3 = Simulink.Parameter(3, StorageClass="Define", DataType="uint8")
NUM4 = Simulink.Parameter(4, StorageClass="Define", DataType="uint8")
NUM5 = Simulink.Parameter(5, StorageClass="Define", DataType="uint8")
NUM6 = Simulink.Parameter(6, StorageClass="Define", DataType="uint8")
NUM7 = Simulink.Parameter(7, StorageClass="Define", DataType="uint8")
NUM8 = Simulink.Parameter(8, StorageClass="Define", DataType="uint8")
NUM9 = Simulink.Parameter(9, StorageClass="Define", DataType="uint8")
NUM10 = Simulink.Parameter(10, StorageClass="Define", DataType="uint8")
Model_Distance = Simulink.Signal(StorageClass="ExportedGlobal", DataType="single")
OFF = Simulink.Parameter(1, StorageClass="Define", DataType="uint8")
ON = Simulink.Parameter(0, StorageClass="Define", DataType="uint8")
SPEED_KD = Simulink.Parameter(0, StorageClass="Define", DataType="single")
Key1 = Simulink.Signal(StorageClass="ExportedGlobal", DataType="uint8")
Key2 = Simulink.Signal(StorageClass="ExportedGlobal", DataType="uint8")
MAX_PWM = Simulink.Parameter(999, StorageClass="Define", DataType="uint16")
Angle = Simulink.Signal(StorageClass="ExportedGlobal", DataType="single")
Balance_PWM = Simulink.Signal(StorageClass="ExportedGlobal", DataType="int16")
Speed_PWM = Simulink.Signal(StorageClass="ExportedGlobal", DataType="int16")
Direction_PWM = Simulink.Signal(StorageClass="ExportedGlobal", DataType="int16")
MIN_PWM = Simulink.Parameter(900, StorageClass="Define", DataType="uint16")
Motor2Speed = Simulink.Signal(StorageClass="ExportedGlobal", DataType="int16")
Motor1Speed = Simulink.Signal(StorageClass="ExportedGlobal", DataType="int16")
BalanceCarTargetSpeed = Simulink.Signal(StorageClass="ExportedGlobal", DataType="int16")
Gyro_Angle = Simulink.Signal(StorageClass="ExportedGlobal", DataType="int16")
Gyro_Turn = Simulink.Signal(StorageClass="ExportedGlobal", DataType="int16")
DirectionTargetPWM = Simulink.Signal(StorageClass="ExportedGlobal", DataType="int16")
BALANCE_KI = Simulink.Parameter(0, StorageClass="Define", DataType="single")
BALANCE_KD = Simulink.Parameter(0.09, StorageClass="Define", DataType="single")
DIRECTION_KI = Simulink.Parameter(0, StorageClass="Define", DataType="single")
DIRECTION_KD = Simulink.Parameter(0.1, StorageClass="Define", DataType="single")
Motor2_A = Simulink.Signal(StorageClass="ExportedGlobal", DataType="uint8", InitialValue="0")
Motor2_B = Simulink.Signal(StorageClass="ExportedGlobal", DataType="uint8", InitialValue="0")
Motor1_A = Simulink.Signal(StorageClass="ExportedGlobal", DataType="uint8", InitialValue="0")
Motor1_B = Simulink.Signal(StorageClass="ExportedGlobal", DataType="uint8", InitialValue="0")
HIGH = Simulink.Parameter(1, StorageClass="Define", DataType="uint8")
LOW = Simulink.Parameter(0, StorageClass="Define", DataType="uint8")
SPEED_KI = Simulink.Parameter(0.01, StorageClass="Define", DataType="single")
Accel_Z = Simulink.Signal(StorageClass="ExportedGlobal", DataType="uint16")
SPEED_KP = Simulink.Parameter(18, StorageClass="Define", DataType="single")
BALANCE_KP = Simulink.Parameter(40, StorageClass="Define", DataType="single")
DIRECTION_KP = Simulink.Parameter(10, StorageClass="Define", DataType="single")
Humidity = Simulink.Signal(StorageClass="ExportedGlobal", DataType="uint8")
BuzzerOutput = Simulink.Signal(StorageClass="ExportedGlobal", DataType="uint16")
Temperature = Simulink.Signal(StorageClass="ExportedGlobal", DataType="uint8")
LedState = Simulink.Signal(StorageClass="ExportedGlobal", DataType="uint8")
BalanceCarOffset = Simulink.Signal(StorageClass="ExportedGlobal", DataType="single")
Tracking_1 = Simulink.Signal(InitialValue="0", StorageClass="ExportedGlobal", DataType="uint8")
Tracking_2 = Simulink.Signal(InitialValue="0", StorageClass="ExportedGlobal", DataType="uint8")
Tracking_3 = Simulink.Signal(InitialValue="0", StorageClass="ExportedGlobal", DataType="uint8")
Tracking_4 = Simulink.Signal(InitialValue="0", StorageClass="ExportedGlobal", DataType="uint8")
Tracking_5 = Simulink.Signal(InitialValue="0", StorageClass="ExportedGlobal", DataType="uint8")